# Grasshopper definition DFLUR5_DR1_T32024.gh (Grasshopper 1.0.7)
# plug-ins: Robots, Bifocals, Pufferfish, Human

# ---- group: Section / Functional Group
# info: Written by Richard Blackwell and Charlotte firth for the Design Futures Lab and BENV10020202
# Template Elements
# Instructions for UR operator: Please ensure you Pen and paper is Correctly loaded, that DFL staff have set up the Robot, and that you have reviewed the simulation in Grasshopper or on the SmartPad
walkthrough = Panel("""step 1
step 2""")

# ----
# DFL DR1 - Simple Drawing
# Grasshopper Instrucitons: Clear Example Data from input Crv
# Set Your Input Curves for drawing
# Click Data Dam to Generate Toolpath
# View/Test Simulation
# Optional: Adjust 'Pen Tilt' to avoid Singularities
# Set File Path for USB Drive
# Name Project
# Click Save Button
# Eject Drive and Load onto Robot
# Click File Load Program
# Select Filename.URP file on USB drive
instructions_for_ur_operator = Panel("Please ensure you Pen and paper is Correctly loaded, that DFL staff have set up the Robot, and that you have reviewed the simulation in Grasshopper or on the SmartPad")

# ---- group: Robot Setup + initial pose
# Robot Setup
list = RobotsLibrary(
    {"DFL - UR5", "DFL- UR5 + Turntable", "DFL - KR70", "UR3e", "UR5e", "UR10e", "UR16e", "UR3", "UR5", "UR10", "Nagami Multimove", "Nagami IRB6700", "Nagami IRB4600", "Nagami IRB6640", "Franka Emika Panda", "Bartlett-IRB120", "Bartlett-IRB1600", "Bartlett-KR6", "Bartlett-KR60-A", "Bartlett-KR60-B", "Bartlett-KR500", "Bartlett-KR60 on track", "Bartlett-UR10", "Bartlett-KR60", "Bartlett-TX200", "Bartlett-TX200L", "Bartlett-RX160", "Bartlett-RX160L", "RMIT UR10"}, selected="UR5",
    Type=0)
inital_pose_axis_values_in_degrees = Panel("""0
-50
-80
-90
90
0""")
loadrobot = LoadRobotSystem(Name=list, Base=PlaneXY(0, 0, 0))
degrees_to_radians = DegreesToRadians(Degrees=inital_pose_axis_values_in_degrees, RobotSystem=loadrobot, MechanicalGroup=0)

# ---- group: Set Up Pen / Tool
retract_height = Slider(4, range=0..8)
pen_pressure = Slider(0.5, range=0..8)

pen_weight_kg = Panel(".01")
name_of_pen = Panel("DR_Basic")
pen_length = Slider(107, range=1..250)
pen_dia = Slider(7.5, range=6..16)
pen_preview_colour = ColourSwatch(SwatchColor=RGB(0, 0, 254))

# ---- group: Setup Fixture
fixture_in_use = ValueList({"Custom Fixture": 0, "Draw Table": 1, "Turn Table": 2}, selected="Draw Table")
robot_placement = ValueList({"Cart": 0, "Table": 1}, selected="Cart")
adaptor_distance_from_table_edge = Slider(162, range=0..600)

custom_z_offset = Slider(0, range=0..50)
custom_x_offset = Slider(500, range=0..800)

# ---- group: Set Up Pen / Tool
dfl_dr1_pen = DFLDR1Pen(d1=name_of_pen, length=pen_length, dia=pen_dia, weight=pen_weight_kg)  # -> tcp, weight_2, mesh_4, tool_data
create_tool = CreateTool(
    Name=flatten(name_of_pen),
    TCP=flatten(dfl_dr1_pen.tcp),
    Weight=flatten(dfl_dr1_pen.weight_2),
    Mesh=flatten(dfl_dr1_pen.mesh_4))  # -> Tool, TCP
tool_centre_point = Panel(create_tool.TCP)

# ---- group: Robot Setup + initial pose
controlled_speed = Slider(100, range=1..100)
transfer_speed = Slider(100, range=1..100)
zone_accuracy = Slider(0.01, range=0..1)

# ---- group: Setup Fixture
dfl_ur_fixutres = DFLURFixutres(A=adaptor_distance_from_table_edge, i_2=robot_placement, d1=custom_z_offset, d2=custom_x_offset, i=fixture_in_use)  # -> G, adaptorplate_2, G_2, fixture_z, fixture_x, i_4, i_3

# ---- group: Fixture preview
table = CustomPreview(Geometry=dfl_ur_fixutres.G, Material=ColourSwatch(SwatchColor=RGBA(217, 185, 126, 200)))
mounts = CustomPreview(Geometry=[dfl_ur_fixutres.adaptorplate_2, dfl_ur_fixutres.G_2], Material=ColourSwatch(SwatchColor=RGB(152, 149, 158)))
fixture = CustomPreview(Geometry=[dfl_ur_fixutres.i_4, dfl_ur_fixutres.i_3], Material=ColourSwatch(SwatchColor=RGB(214, 214, 214)))

# ---- group: Paper Size and position
length_x = Slider(297, range=0..420)
width_y = Slider(210, range=0..420)
x_distance_from_robot = Panel(dfl_ur_fixutres.fixture_x)
fixtureheight_z = Panel(dfl_ur_fixutres.fixture_z)
dfl_paper_setup = DFLPaperSetup(A_2=length_x, A_3=width_y, X=x_distance_from_robot, A=fixtureheight_z)  # -> I_2, I, P

# ----
# Drawing Setup
_4_point_calibration_x_y_z = Panel("")

# ---- group: Drawing import
layer_name_case_sensitive = Panel("Black")
crv = Curve([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])

# ---- group: Path Planning / Move Drawing To Paper / Re Calculate
dam = DataDam(DataA=crv, BufferDelay=2500000, BufferMode=0)

# ---- group: Robots Commands / Pen Change
concat = Concatenate(FragmentB=name_of_pen, FragmentC="_change")
concat_2 = Concatenate(
    FragmentA="Insert ",
    FragmentB=name_of_pen,
    FragmentD=" for ",
    FragmentE=layer_name_case_sensitive,
    FragmentC=" layer and click continue to resume")
pen_change_pose_av_degrees = Panel("""24.38
-106.28
-87.02
-168.27
24.22
46.25""")
popup_title_no_spaces = Panel(concat)
popup_text = Panel(concat_2)
degrees_to_radians_2 = DegreesToRadians(Degrees=pen_change_pose_av_degrees, RobotSystem=loadrobot, MechanicalGroup=0)
dfl_ur_custom_popup = DFLURCustomPopup(N=popup_title_no_spaces, B=popup_text)
create_target = CreateTarget(
    Joints=degrees_to_radians_2,
    Tool=flatten(create_tool.Tool),
    Speed=transfer_speed,
    Zone=zone_accuracy,
    Command=dfl_ur_custom_popup,
    IsCartesian=False)

# ---- group: Robots Commands / Inital Pose
# Robotic Commands
popup_title_no_spaces_2 = Panel("Operator_Safety")
popup_text_2 = Panel(instructions_for_ur_operator)
dfl_ur_custom_popup_2 = DFLURCustomPopup(N=popup_title_no_spaces_2, B=popup_text_2)
create_target_2 = CreateTarget(
    Joints=degrees_to_radians,
    Tool=create_tool.Tool,
    Speed=transfer_speed,
    Zone=zone_accuracy,
    Command=dfl_ur_custom_popup_2,
    IsCartesian=False)

# ---- group: Robots Commands
popup_title_no_spaces_3 = Panel("Job_Done")
popup_text_3 = Panel("Job Complete! Please put all the caps back on the pens and tidy up!")
dfl_ur_custom_popup_3 = DFLURCustomPopup(N=popup_title_no_spaces_3, B=popup_text_3)
create_target_3 = CreateTarget(
    Joints=degrees_to_radians,
    Tool=create_tool.Tool,
    Speed=transfer_speed,
    Zone=zone_accuracy,
    Command=dfl_ur_custom_popup_3,
    IsCartesian=False)

# ---- group: Save URP / Program Name
# Save
panel = Panel("DR1_Your_Name")

# ---- group: Paper Preview
paper_outline = ColourSwatch(SwatchColor=RGB(0, 0, 0))

# ---- group: Paper Plane
ideal_paper_plane = Plane(dfl_paper_setup.P)
paper_plane = Plane(ideal_paper_plane)

# ---- group: 4 point Calibration
dfl_4_point_calibration = DFL4PointCalibration(L=_4_point_calibration_x_y_z, G=ideal_paper_plane)

# ---- group: Paper Plane (continued)
calibrated_plane = Plane(dfl_4_point_calibration)

# ---- group: Paper Preview (continued)
rectangle = Rectangle(Plane=paper_plane, XSize=dfl_paper_setup.I_2, YSize=dfl_paper_setup.I, Radius=0)  # -> Rectangle, Length
previewlw = CustomPreviewLineweights(Geometry=rectangle.Rectangle, Shader=paper_outline, Absolute=False)

# ---- group: Create Pressure planes
multiplication = Multiplication(A=pen_pressure, B=-1)
pl_offset = PlaneOffset(BasePlane=paper_plane, Offset=multiplication)
pen_pressed_plane = Plane(pl_offset)

# ---- group: Create Transfer Planes
pl_offset_2 = PlaneOffset(BasePlane=paper_plane, Offset=retract_height)
pen_transfer_plane = Plane(pl_offset_2)

# ---- group: Path Planning / Move Drawing To Paper
paper_plane_2 = Plane(pen_pressed_plane)
bbox = BoundingBox(Content=flatten(dam), Plane=paper_plane_2, UnionBox=True)  # -> Box, Box_2
project = Project(Geometry=dam, Plane=paper_plane_2)  # -> Geometry, Transform
area = Area(Geometry=bbox.Box)  # -> Area, Centroid
move2pt = MoveToPoint(Geometry=project.Geometry, PointB=paper_plane)  # -> Moved, Vector, Transform

# ---- group: Drawing Preview
pt = Point(Point(0, 0, 0.1))
move = Move(Geometry=move2pt.Moved, Motion=pt)  # -> Geometry, Transform
previewlw_2 = CustomPreviewLineweights(Geometry=move.Geometry, Shader=pen_preview_colour, Absolute=False)

# ---- group: Path Planning
transfer_plane = Plane(pen_transfer_plane)
dfl_add_leads = DFLAddLeads(transfer_plane=transfer_plane, curves=move2pt.Moved)

number_slider = Slider(0.01, range=0..10)

# ---- group: Path Planning / Divide (Polyline)
dfl_curves_to_planes = DFLCrvToPln(B=paper_plane, C=dfl_add_leads, td=number_slider)

# ---- group: Path Planning / Reorient Planes
pen_tilt = Slider(0, range=0..45)
list_2 = ValueList({"0 deg": 0, "90 deg": 90, "180 deg": 180, "270 deg": 270, "360 deg": 360}, selected="180 deg")
list_3 = ValueList({"x": 0, "y": 1, "z": 2}, selected="x")
dfl_orient_planes = DFLOrientPln(planes=dfl_curves_to_planes, rotation_axis=list_3, fine_adjustment=pen_tilt, quad_rotate=list_2)

# ---- group: Path Planning
pen_tilt_2 = Slider(0, range=0..45)
list_4 = ValueList({"0 deg": 0, "90 deg": 90, "180 deg": 180, "270 deg": 270, "360 deg": 360}, selected="90 deg")
list_5 = ValueList({"x": 0, "y": 1, "z": 2}, selected="z")
dfl_re_orient_planes = DFLOrientPln(planes=dfl_orient_planes, rotation_axis=list_5, fine_adjustment=pen_tilt_2, quad_rotate=list_4)

pln = Plane(dfl_re_orient_planes)

# ---- group: Robots Commands / Linear Movements
list_6 = ValueList({"Joint", "Linear"}, selected="Linear")
controlled_speed_2 = Panel(controlled_speed)
create_target_4 = CreateTarget(Plane=pln, Motion=list_6, Tool=graft(create_tool.Tool), Speed=controlled_speed_2, Zone=zone_accuracy, IsCartesian=True)

# ---- group: Robots Commands / Order Program
merge = Merge(Data1=create_target_2, Data2=create_target, Data3=flatten(create_target_4), Data4=create_target_3)  # -> flatten(Result)

# ---- group: Simulate
create_program = CreateProgram(Name=panel, RobotSystem=loadrobot, Targets=merge, StepSize=1)  # -> Program, Code, Duration, Warnings, Errors
# Simulate Preview Export
sim_slider = Slider(0, range=0..1)
program_simulation = ProgramSimulation(Program=create_program.Program, Time=sim_slider, Normalized=True)  # -> SystemMeshes, JointRotations, Plane, Index, Time, flatten(Program), Errors

# ---- group: Analysis
any_program_warnings = Panel(create_program.Warnings)
any_program_errors = Panel(create_program.Errors)
duration = Panel(create_program.Duration)
degrees = Degrees(Radians=graft(program_simulation.JointRotations))  # -> simplify(Degrees)
each_axis_rotation_analysis = Panel(degrees)

# ---- group: Save URP
save_as_urp = Button()
select_directory = FilePath("/Volumes/RB/UR/")
set_as_your_usb_drive = Panel(select_directory)
dispatch = Dispatch(List=set_as_your_usb_drive, DispatchPattern=save_as_urp)  # -> ListA, ListB
saveprog = SaveProgram(Program=create_program.Program, Folder=dispatch.ListA)

# ---- group: Preview Robot
tool_colour = ColourSwatch(SwatchColor=RGB(168, 168, 168))
custom_preview = CustomPreview(Geometry=program_simulation.SystemMeshes, Material=tool_colour)

# ---- group: Preview Robot / Colour Swatch
trail = SimpleTrail(Program=program_simulation.Program, Length=500, MechanicalGroup=0)

# ==== cluster DFLURFixutres
turntablebase = Mesh(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)
drawing_table = Mesh(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)
turntable = Mesh(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)
zoffset = Panel("34.8")
zoffset_2 = Panel("19")
mesh = Mesh(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)
zoffset_3 = Panel("0")
d1 = ClusterInput()
d2 = ClusterInput()
carttrack = Mesh([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])
carttabletop = Mesh(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)
tabletop = Mesh(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)
merge = Merge(Data1=zoffset_2, Data2="500", Data3=drawing_table, Data4=mesh)
tabletrack = Mesh([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])
merge_2 = Merge(Data1=zoffset, Data2="500", Data3=turntablebase, Data4=turntable)
merge_3 = Merge(Data1=d1, Data2=d2, Data3=mesh, Data4=mesh)
merge_4 = Merge(Data1=carttabletop, Data2=flatten(carttrack))
merge_5 = Merge(Data1=tabletop, Data2=flatten(tabletrack))
merge_6 = Merge(Data1=graft(merge_3), Data2=graft(merge), Data3=graft(merge_2))
i = ClusterInput()
merge_7 = Merge(Data1=graft(merge_4), Data2=graft(merge_5))
i_2 = ClusterInput()
item = ListItem(List=merge_6, Index=i, Wrap=True)
item_2 = ListItem(List=merge_7, Index=i_2, Wrap=True)
A = ClusterInput()
tabletop_2 = ListItem(List=flatten(item_2), Index=0, Wrap=True)
track = ListItem(List=flatten(item_2), Index=1, Wrap=True)
track_2 = ListItem(List=flatten(item_2), Index=2, Wrap=True)
tabletop_3 = ListItem(List=flatten(item), Index=0, Wrap=False)
track_3 = ListItem(List=flatten(item), Index=1, Wrap=False)
track_4 = ListItem(List=flatten(item), Index=2, Wrap=False)
track_5 = ListItem(List=flatten(item), Index=3, Wrap=False)
multiplication = Multiplication(A=A, B=-1)
i_3 = ClusterOutput(track_5)
fixture_z = ClusterOutput(tabletop_3)
fixture_x = ClusterOutput(track_3)
i_4 = ClusterOutput(track_4)
adaptorplate = Mesh(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)
pt = ConstructPoint(XCoordinate=multiplication, YCoordinate=0, ZCoordinate=0)
move = Move(Geometry=tabletop_2, Motion=pt)  # -> Geometry, Transform
move_2 = Move(Geometry=[track, track_2], Motion=pt)  # -> Geometry, Transform
G = ClusterOutput(move.Geometry)
adaptorplate_2 = ClusterOutput(adaptorplate)
G_2 = ClusterOutput(move_2.Geometry)

# ==== cluster DFLDR1Pen
d1 = ClusterInput()
length = ClusterInput()
dia = ClusterInput()
weight = ClusterInput()
mesh = Mesh(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)
pen_length_offset = Panel("1.5")
pen_v_block_offset_mm = Panel("16")
holder_weight = Panel(".133")
division = Division(A=dia, B=2)
pt = ConstructPoint(XCoordinate=division, YCoordinate=division, ZCoordinate=0)
addition = Addition(A=holder_weight, B=weight)
xy = XYPlane(Origin=pt)
cir = Circle(Plane=xy, Radius=division)
subtraction = Subtraction(A=length, B=pen_length_offset)
pt_2 = Point(Point(0, 0, 0))
pt_3 = ConstructPoint(XCoordinate=0, YCoordinate=0, ZCoordinate="1")
ln = Line(StartPoint=pt_2, EndPoint=pt_3)
rotax = RotateAxis(Geometry=cir, Angle=degrees("45"), Axis=ln)  # -> Geometry, Transform
pt_4 = ConstructPoint(XCoordinate="1", YCoordinate=0, ZCoordinate=0)
ln_2 = Line(StartPoint=pt_2, EndPoint=pt_4)
rotax_2 = RotateAxis(Geometry=rotax.Geometry, Angle=degrees("90"), Axis=ln_2)  # -> Geometry, Transform
pt_5 = ConstructPoint(XCoordinate=0, YCoordinate=subtraction, ZCoordinate=pen_v_block_offset_mm)
merge = Merge(Data1=division, Data2=division)
move = Move(Geometry=rotax_2.Geometry, Motion=pt_5)  # -> Geometry, Transform
pt_6 = ConstructPoint(XCoordinate=0, YCoordinate=0, ZCoordinate="1")
lng = ListLength(List=merge)
ln_3 = Line(StartPoint=pt_2, EndPoint=pt_6)
range = Range(Domain="0 to 1", Steps=expr("x-1", lng))
rotax_3 = RotateAxis(Geometry=move.Geometry, Angle=degrees("-45"), Axis=ln_3)  # -> Geometry, Transform
pen_visulaization_hack = GraphMapper(range, x0=0, x1=1, y0=0, y1=1, container_name="Bezier", cpx=[0, 0.1894655079, 0, 1], cpy=[0, 0.6900714636, 1, 1])
area = Area(Geometry=rotax_3.Geometry)  # -> Area, Centroid
pdecon = Deconstruct(Point=area.Centroid)  # -> XComponent, YComponent, ZComponent
pt_7 = ConstructPoint(XCoordinate=0, YCoordinate=0, ZCoordinate=pdecon.ZComponent)
ln_4 = Line(StartPoint=pt_7, EndPoint=area.Centroid)
vpipe = PipeVariable(Curve=ln_4, Parameters=pen_visulaization_hack, Radii=merge, Caps=2)
mesh_2 = MeshBrep(
    Brep=vpipe,
    Settings={GridMaxCount=0, GridMinCount=16, JaggedSeams=False, MaxEdgeLength=0, MinEdgeLength=0.0001, MinTolerance=0, Refine=True, RefineAngle=0, RelativeTolerance=0.65, SimplePlanes=True, Tolerance=0})
pframes = PerpFrames(Curve=ln_4, Count="1", Align=True)  # -> Frames, Parameters
munion = MeshUnion(Meshes=flatten([mesh, mesh_2]))
item = ListItem(List=pframes.Frames, Index=1, Wrap=True)
pln = Plane(flatten(item))
num = Number(addition)
mesh_3 = Mesh(munion)
weight_2 = ClusterOutput(num)
mesh_4 = ClusterOutput(mesh_3)
tcp = ClusterOutput(pln)
tool_data = ClusterOutput()

# ==== cluster DFLURCustomPopup
N = ClusterInput()
B = ClusterInput()
concat = Concatenate(
    FragmentA="popup (\"",
    FragmentB=B,
    FragmentC="\", title=\"",
    FragmentD=N,
    FragmentE="\", warning=False, error=False, blocking=True)")
customcmd = CustomCommand(Name=N, Manufacturer="UR", Code=concat)
C = ClusterOutput(customcmd)

# ==== cluster DFL4PointCalibration
L = ClusterInput()
G = ClusterInput()
item = ListItem(List=L, Index=0, Wrap=True)  # -> Item, Item1, Item2, Item3
plfit = PlaneFit(Points=L)  # -> Plane, Deviation
srf4pt = _4PointSurface(CornerA=item.Item, CornerB=item.Item1, CornerC=item.Item2, CornerD=item.Item3)
flippln = FlipPlane(Plane=plfit.Plane, Guide=G, FlipX=False, FlipY=False, FlipZ=True)  # -> Flipped, R
area = Area(Geometry=srf4pt)  # -> Area, Centroid
move2pt = MoveToPoint(Geometry=flippln.Flipped, PointA=flippln.Flipped, PointB=<missing>)  # -> Moved, Vector, Transform
M = ClusterOutput(move2pt.Moved)

# ==== cluster DFLPaperSetup
A = ClusterInput()
A_2 = ClusterInput()
A_3 = ClusterInput()
X = ClusterInput()
subtraction = Subtraction(A=A, B=15)
multiplication = Multiplication(A=A_3, B=-0.5)
multiplication_2 = Multiplication(A=A_3, B=0.5)
multiplication_3 = Multiplication(A=A_2, B=-0.5)
multiplication_4 = Multiplication(A=A_2, B=0.5)
pt = ConstructPoint(XCoordinate=X, YCoordinate=0, ZCoordinate=subtraction)
dom = ConstructDomain(DomainStart=multiplication, DomainEnd=multiplication_2)
dom_2 = ConstructDomain(DomainStart=multiplication_3, DomainEnd=multiplication_4)
xy = XYPlane(Origin=pt)
I = ClusterOutput(dom)
I_2 = ClusterOutput(dom_2)
P = ClusterOutput(xy)

# ==== cluster DFLAddLeads
curves = ClusterInput()
transfer_plane = ClusterInput()

# ---- group: Lead In and Out
join = JoinCurves(Curves=curves, Preserve=False)
opncrv = OpenCurve(Curve=join, Length=0.001, Normalized=False, Seam=0)  # -> Opened, R
end = EndPoints(Curve=opncrv.Opened)  # -> Start, End
project = Project(Geometry=end.Start, Plane=transfer_plane)  # -> Geometry, Transform
project_2 = Project(Geometry=end.End, Plane=transfer_plane)  # -> Geometry, Transform
ln = Line(StartPoint=project_2.Geometry, EndPoint=end.End)
ln_2 = Line(StartPoint=project.Geometry, EndPoint=end.Start)
weave = Weave(Pattern=[0, 1, 2], Stream0=ln_2, Stream1=opncrv.Opened, Stream2=ln, NullGaps=False)
join_2 = JoinCurves(Curves=weave, Preserve=False)  # -> simplify(Curves)

# ----
curves_with_leads = ClusterOutput(join_2)

# ==== cluster DFLCrvToPln: Turns Curves to Polylines, then divides Curved Sections Basesd on a tollarance input, Positions a plane at each point
C = ClusterInput()
td = ClusterInput()
topoly = CurveToPolyline(Curve=C, ToleranceDistance=td, ToleranceAngle=0)  # -> Polyline, Segments
cp = ControlPoints(Curve=topoly.Polyline)  # -> simplify(Points), Weights, Knots
B = ClusterInput()
pl_origin = PlaneOrigin(Base=B, Origin=cp.Points)  # -> simplify(Plane)
pl = ClusterOutput(pl_origin)

# ==== cluster DFLOrientPln: Rotates inputted planes in an inputted axis, Two rotation inputs are combined to seperate fine and course control
planes = ClusterInput()
rotation_axis = ClusterInput()  # X=0 Y=1 Z=2
fine_adjustment = ClusterInput()
quad_rotate = ClusterInput()

deplane = DeconstructPlane(Plane=planes)  # -> Origin, XAxis, YAxis, ZAxis
filter = StreamFilter(Gate=rotation_axis, Stream0=deplane.XAxis, Stream1=deplane.YAxis, Stream2=deplane.ZAxis)
amp = Amplitude(Vector=filter, Amplitude="1")
move = Move(Geometry=deplane.Origin, Motion=amp)  # -> Geometry, Transform
ln = Line(StartPoint=deplane.Origin, EndPoint=move.Geometry)
addition = Addition(A=fine_adjustment, B=quad_rotate)
rotax = RotateAxis(Geometry=planes, Angle=degrees(addition), Axis=ln)  # -> Geometry, Transform

rotated_planes = ClusterOutput(rotax.Geometry)
